# Grasshopper definition base.ghx (Grasshopper 0.9.76)

c_script = CSharpScript()  # -> out, A
# ---------- c_script: C# ----------
[--Main Program--]
# ---------- c_script: C# additional code ----------
[--Additional Source--]
# ---------- end c_script ----------
